# Grasshopper definition Basic Setup.ghx (Grasshopper 1.0.7)
# plug-ins: SandWorm

crv = Curve(<curve referenced from the Rhino model>)
pt = Point(<point referenced from the Rhino model>)

sandworm = SandWorm(
    OriginOfPointcloud=pt,
    ResolutionOfPointcloud=Slider(10, range=0..20),
    DepthOfPointcloud=Slider(2, range=0..10),
    TrimRectangle=crv,
    SmoothingFactor=Slider(0, range=0..1),
    SmoothingIterations=Slider(0, range=0..10))  # -> Pointcloud, ColorOfPointcloud, Mesh, Contours, Output

# ---- group: Disabled for speed
points = Point(sandworm.Pointcloud)  # disabled
preview = CustomPreview(Geometry=points, Material=sandworm.ColorOfPointcloud)  # disabled

# ----
mesh = Mesh(sandworm.Mesh)
contours = Curve(sandworm.Contours)
preview_2 = CustomPreview(Geometry=mesh, Material=ColourSwatch(SwatchColor=RGBA(255, 255, 255, 153)))
preview_3 = CustomPreview(Geometry=contours, Material=ColourSwatch(SwatchColor=RGB(255, 255, 255)))
