# Grasshopper definition Projector and Camera Planner.gh (Grasshopper 1.0.7)

# ---- group: Kinect for Windows FoVs
color_pixels_y = Slider(1080, range=0..2000)
color_pixels_x = Slider(512, range=0..10000)
depth_pixels_y = Slider(424, range=0..2000)
color_pixels_x_2 = Slider(1920, range=0..10000)
max_range = Slider(4500, range=0..6000)
y_color_fov = Slider(54, range=0..100)
min_range = Slider(250, range=0..6000)
x_color_fov = Slider(84, range=0..100)
y_depth_fov = Slider(60, range=0..100)
x_depth_fov = Slider(70.6, range=0..100)

# ----
# Example Projector Specs
# 
# NEC L102W
projector_throw_ratio = Slider(1.4, range=0.2..2)
# 1. Configure Projector Dimensions
projector_x = Slider(330, range=0..1000)
projector_y = Slider(44, range=0..300)
projector_z = Slider(177, range=0..500)
list = ValueList({"4:3": 1.333333333, "16:9": 1.777777778, "16:10": 1.6}, selected="16:10")

# ---- group: Kinect for Azure NFOV unbinned
color_pixels_y_2 = Slider(3072, range=0..50000)
depth_pixels_y_2 = Slider(576, range=0..10000)
max_range_2 = Slider(3860, range=0..6000)
depth_pixels_x = Slider(640, range=0..2000)
color_pixels_x_3 = Slider(4096, range=0..50000)
min_range_2 = Slider(500, range=0..6000)
y_color_fov_2 = Slider(74.3, range=0..100)
x_color_fov_2 = Slider(90, range=0..100)
y_depth_fov_2 = Slider(65, range=0..120)
x_depth_fov_2 = Slider(75, range=0..120)

# ---- group: Kinect for Windows Dimensions
# 1. Configure Sensor Dimensions
sensor_x = Slider(249, range=0..1000)
sensor_y = Slider(67, range=0..100)
sensor_z = Slider(60, range=0..100)

# ---- group: Key INPUTS
max_model_height_mm = Slider(200, range=0..500)
sensor_offset_y = Slider(141, range=-1000..1000)
sensor_offset_x = Slider(0, range=-1000..1000)
sensor_height = Slider(636, range=250..6000)

# ----
# Example Projector Specs
# 
# NEC M302WSG
projector_throw_ratio_2 = Slider(0.53, range=0.2..2)
projector_x_2 = Slider(330, range=0..1000)
projector_y_2 = Slider(160, range=0..300)
projector_z_2 = Slider(270, range=0..500)
list_2 = ValueList({"4:3": 1.333333333, "16:9": 1.777777778, "16:10": 1.6}, selected="16:10")

buffer_width = Slider(100, range=0..1000)
# 2. Configure Table Specs
tray_depth = Slider(97, range=0..100)
tray_height = Slider(1500, range=0..2000)
tray_width = Slider(2000, range=0..3000)

# ---- group: Kinect for Azure WFOV unbinned
color_pixels_y_3 = Slider(3072, range=0..50000)
depth_pixels_x_2 = Slider(1024, range=0..2000)
depth_pixels_y_3 = Slider(1024, range=0..10000)
max_range_3 = Slider(2210, range=0..6000)
color_pixels_x_4 = Slider(4096, range=0..50000)
x_color_fov_3 = Slider(90, range=0..100)
y_color_fov_3 = Slider(74.3, range=0..100)
min_range_3 = Slider(250, range=0..6000)
# 3. Configure Sensor Specs
x_depth_fov_3 = Slider(120, range=0..120)
y_depth_fov_3 = Slider(120, range=0..120)

# ---- group: Kinect for Windows Dimensions / Kinect for Azure Dimensions
sensor_x_2 = Slider(103, range=0..1000)
sensor_y_2 = Slider(39, range=0..100)
sensor_z_2 = Slider(125, range=0..150)

# ----
sensor_x_3 = Number(sensor_x_2)
sensor_y_3 = Number(sensor_y_2)
sensor_z_3 = Number(sensor_z_2)
projector_z_3 = Number(projector_z_2)
throw_ratio = Number(projector_throw_ratio_2)
projector_x_3 = Number(projector_x_2)
projector_y_3 = Number(projector_y_2)
aspect_ratio = Number(list_2)
tray_depth_2 = Number(tray_depth)
tray_width_2 = Number(tray_width)
tray_height_2 = Number(tray_height)
buffer_width_2 = Number(buffer_width)
x_depth_fov_4 = Number(x_depth_fov_3)
y_depth_fov_4 = Number(y_depth_fov_3)
x_color_fov_4 = Number(x_color_fov_3)
min_range_4 = Number(min_range_3)
color_pixels_x_5 = Number(color_pixels_x_4)
color_pixels_y_4 = Number(color_pixels_y_3)
y_color_fov_4 = Number(y_color_fov_3)
max_range_4 = Number(max_range_3)
depth_pixels_y_4 = Number(depth_pixels_y_3)
depth_pixels_x_3 = Number(depth_pixels_x_2)

# ---- group: Sensor model
division = Division(A=sensor_x_3, B=2)
division_2 = Division(A=sensor_y_3, B=2)
division_3 = Division(A=sensor_z_3, B=2)
addition = Addition(A=sensor_height, B=max_model_height_mm)
pt = ConstructPoint(XCoordinate=sensor_offset_x, YCoordinate=sensor_offset_y, ZCoordinate=addition)
Z = UnitZ(Factor=division_3)
move = Move(Geometry=pt, Motion=Z)  # -> Geometry, Transform
xy = XYPlane(Origin=Point(0, 0, 0))
multiplication = Multiplication(A=max_model_height_mm, B=-1)
X = UnitX(Factor=division)
move_2 = Move(Geometry=move.Geometry, Motion=X)  # -> Geometry, Transform
pl_offset = PlaneOffset(BasePlane=xy, Offset=multiplication)
box = CenterBox(Base=move.Geometry, X=division, Y=division_2, Z=division_3)
pt_2 = Point(move_2.Geometry)
cone = Cone(Base=pl_offset, Radius=max_model_height_mm, Length=max_model_height_mm)  # -> Cone, Tip
example_of_max_model_height = Geometry(cone.Cone)
model_base_plane = Plane(pl_offset)
sensor_model = Brep(box)
sensor_origin = Point(pt)

# ---- group: Calculate Depth FoV (circular; for Azure WFOV)
xy_depth_fov = Number(x_depth_fov_4)
sensor_origin_2 = Point(sensor_origin)
cluster = Cluster_2(P=sensor_origin_2, D=xy_depth_fov)  # -> C, R, R_2, R_3
depth_fov_circumference = Curve(cluster.C)
inscribed_range = Number(cluster.R_2)
polar_range = Number(cluster.R)

# ---- group: Calculate Depth FoV (rectangular)
sensor_origin_3 = Point(sensor_origin)
x_depth_fov_5 = Number(x_depth_fov_4)
y_depth_fov_5 = Number(y_depth_fov_4)
cluster_2 = Cluster(P=sensor_origin_3, D=x_depth_fov_5, D_2=y_depth_fov_5)  # -> R_3, R_2, R
depth_fov_perimeter = Curve(cluster_2.R_3)
horizontal_range = Number(cluster_2.R_2)
vertical_range = Number(cluster_2.R)

# ---- group: Calculate Color FoV (rectangular)
sensor_origin_4 = Point(sensor_origin)
y_color_fov_5 = Number(y_color_fov_4)
x_color_fov_5 = Number(x_color_fov_4)
cluster_3 = Cluster(P=sensor_origin_4, D=x_color_fov_5, D_2=y_color_fov_5)  # -> R_3, R_2, R
color_fov_perimeter = Curve(cluster_3.R_3)
horizontal_range_2 = Number(cluster_3.R_2)
vertical_range_2 = Number(cluster_3.R)

# ----
depth_fov_inscribed = Curve(cluster.R_3)
horizontal_depth_range = Number(inscribed_range)
depth_fov_perimeter_2 = Curve(depth_fov_inscribed)
vertical_depth_range = Number(inscribed_range)
horizontal_color_range = Number(horizontal_range_2)
color_fov_perimeter_2 = Curve(color_fov_perimeter)
vertical_color_range = Number(vertical_range_2)
max = Maximum(A=vertical_depth_range, B=vertical_color_range)
max_2 = Maximum(A=horizontal_depth_range, B=horizontal_color_range)

buffer_width_3 = Number(buffer_width_2)
model_base_plane_2 = Plane(model_base_plane)
tray_depth_3 = Number(tray_depth_2)
tray_width_3 = Number(tray_width_2)
tray_height_3 = Number(tray_height_2)
division_4 = Division(A=tray_width_3, B=2)
division_5 = Division(A=tray_width_3, B=-2)
division_6 = Division(A=tray_height_3, B=2)
division_7 = Division(A=tray_height_3, B=-2)
pt_3 = ConstructPoint(XCoordinate=division_5, YCoordinate=division_6, ZCoordinate=0)
pt_4 = ConstructPoint(XCoordinate=division_4, YCoordinate=division_7, ZCoordinate=0)
Z_2 = UnitZ(Factor=tray_depth_3)
rec_2pt = Rectangle2Pt(Plane=model_base_plane_2, PointA=pt_3, PointB=pt_4, Radius=0)  # -> Rectangle, Length
multiplication_2 = Multiplication(A=Z_2, B=0.5)
move_3 = Move(Geometry=rec_2pt.Rectangle, Motion=Z_2)  # -> Geometry, Transform
make_sand = MakeSand(G=rec_2pt.Rectangle, T=multiplication_2, A=tray_depth_3)
boundary = BoundarySurfaces(Edges=rec_2pt.Rectangle)
offset = OffsetCurve(Curve=rec_2pt.Rectangle, Distance=buffer_width_3, Plane=PlaneXY(0, 0, 0), Corners=1)
Z_3 = UnitZ(Factor=-1)
loft = Loft(
    Curves=[move_3.Geometry, rec_2pt.Rectangle],
    Options={Adjust=False, Closed=False, LoftEnds=0, LoftSimp=0, LoftType=0, Rebuild=10, Refit=0.01})
move_4 = Move(Geometry=offset, Motion=Z_3)  # -> Geometry, Transform
boundary_2 = BoundarySurfaces(Edges=move_4.Geometry)
table_surface = Geometry([loft, boundary])
table_surface_2 = Geometry(boundary_2)
sand_surface = Geometry(make_sand)

# ---- group: Determine needed projector height above table
projection_overshot = Slider(0, range=-500..500)
minimum_width_of_projected_image = Number(max_2)
projection_overshot_2 = Slider(0, range=-500..500)
minimum_height_of_projected_image = Number(max)
throw_ratio_2 = Number(throw_ratio)
aspect_ratio_2 = Number(aspect_ratio)
addition_2 = Addition(A=minimum_height_of_projected_image, B=projection_overshot)
addition_3 = Addition(A=minimum_width_of_projected_image, B=projection_overshot_2)
multiplication_3 = Multiplication(A=aspect_ratio_2, B=addition_2)
multiplication_4 = Multiplication(A=throw_ratio_2, B=addition_3)
multiplication_5 = Multiplication(A=throw_ratio_2, B=multiplication_3)
max_3 = Maximum(A=multiplication_4, B=multiplication_5)
division_8 = Division(A=max_3, B=throw_ratio_2)
division_9 = Division(A=division_8, B=aspect_ratio_2)
height_of_projector_above_table = Number(max_3)
projected_height = Number(division_9)
projected_width = Number(division_8)

# ---- group: Minimum modelling area (RECTANGULAR)
color_fov_perimeter_3 = Curve(color_fov_perimeter_2)
depth_fov_perimeter_3 = Curve(depth_fov_perimeter_2)
drec = DeconstuctRectangle(Rectangle=color_fov_perimeter_3)  # -> BasePlane, XInterval, YInterval
drec_2 = DeconstuctRectangle(Rectangle=depth_fov_perimeter_3)  # -> BasePlane, XInterval, YInterval
dedomain = DeconstructDomain(Domain=drec_2.XInterval)  # -> Start, End
dedomain_2 = DeconstructDomain(Domain=drec.XInterval)  # -> Start, End
dedomain_3 = DeconstructDomain(Domain=drec_2.YInterval)  # -> Start, End
dedomain_4 = DeconstructDomain(Domain=drec.YInterval)  # -> Start, End
max_4 = Maximum(A=dedomain.Start, B=dedomain_2.Start)
min = Minimum(A=dedomain.End, B=dedomain_2.End)
max_5 = Maximum(A=dedomain_3.Start, B=dedomain_4.Start)
min_2 = Minimum(A=dedomain_3.End, B=dedomain_4.End)
pt_5 = ConstructPoint(XCoordinate=max_4, YCoordinate=max_5, ZCoordinate=0)
pt_6 = ConstructPoint(XCoordinate=min, YCoordinate=min_2, ZCoordinate=0)
rec_2pt_2 = Rectangle2Pt(Plane=PlaneXY(0, 0, 0), PointA=pt_5, PointB=pt_6, Radius=0)  # -> Rectangle, Length
combined_minimum_fov_perimeter = Curve(rec_2pt_2.Rectangle)
addition_4 = Addition(A=min, B=min)
minimum_x = Panel(addition_4)
addition_5 = Addition(A=min_2, B=min_2)
minimum_y = Panel(addition_5)

# ----
text_size = Slider(23, range=0..100)

# ---- group: Perimeters and Rays / Show Rays
depth_fov_perimeter_4 = Curve(depth_fov_perimeter_2)
sensor_origin_5 = Point(sensor_origin)
explode = Explode(Curve=depth_fov_perimeter_4, Recursive=True)  # -> Segments, Vertices
ln = Line(StartPoint=sensor_origin_5, EndPoint=explode.Vertices)
preview = CustomPreview(Geometry=[depth_fov_perimeter_4, ln], Material=ColourSwatch(SwatchColor=RGB(255, 0, 247)))

color_fov_perimeter_4 = Curve(color_fov_perimeter_2)
sensor_origin_6 = Point(sensor_origin)
explode_2 = Explode(Curve=color_fov_perimeter_4, Recursive=True)  # -> Segments, Vertices
ln_2 = Line(StartPoint=sensor_origin_6, EndPoint=explode_2.Vertices)
preview_2 = CustomPreview(Geometry=[color_fov_perimeter_4, ln_2], Material=ColourSwatch(SwatchColor=RGB(0, 255, 255)))

# ---- group: Perimeters and Rays
combined_minimum_fov_perimeter_2 = Curve(combined_minimum_fov_perimeter)
text_color = ColourSwatch(SwatchColor=RGBA(255, 255, 255, 87))
boundary_3 = BoundarySurfaces(Edges=combined_minimum_fov_perimeter_2)
preview_3 = CustomPreview(Geometry=combined_minimum_fov_perimeter_2, Material=text_color)
preview_4 = CustomPreview(Geometry=boundary_3, Material=text_color)

# ---- group: Model Projector itself
projector_offset_y = Slider(-394, range=-1000..1000)
lens_y = Slider(0, range=-1000..1000)
projector_offset_x = Slider(0, range=-1000..1000)
lens_x = Slider(0, range=-1000..1000)
projector_y_4 = Number(projector_y_3)
projector_z_4 = Number(projector_z_3)
projector_x_4 = Number(projector_x_3)
pt_7 = ConstructPoint(XCoordinate=projector_offset_x, YCoordinate=projector_offset_y, ZCoordinate=0)
xy_2 = XYPlane(Origin=pt_7)
pl_offset_2 = PlaneOffset(BasePlane=xy_2, Offset=height_of_projector_above_table)
vec = VectorXYZ(XComponent=lens_x, YComponent=lens_y, ZComponent=0)  # -> Vector, Length
move_5 = Move(Geometry=pl_offset_2, Motion=vec.Vector)  # -> Geometry, Transform
lens_origin = Point(move_5.Geometry)

# ----
division_10 = Division(A=projector_x_4, B=2)
division_11 = Division(A=projector_z_4, B=2)
division_12 = Division(A=projector_y_4, B=2)
X_2 = UnitX(Factor=division_10)

# ---- group: Model Projector itself (continued)
pl_offset_3 = PlaneOffset(BasePlane=pl_offset_2, Offset=division_11)
box_2 = CenterBox(Base=pl_offset_3, X=division_10, Y=division_12, Z=division_11)
projector_model = Geometry(box_2)
move_6 = Move(Geometry=pl_offset_3, Motion=X_2)  # -> Geometry, Transform
pt_8 = Point(move_6.Geometry)

# ----
projected_height_2 = Number(projected_height)
projected_width_2 = Number(projected_width)
projection_origin = Point(lens_origin)
division_13 = Division(A=projected_width_2, B=2)
division_14 = Division(A=projected_height_2, B=2)
division_15 = Division(A=projected_width_2, B=-2)
division_16 = Division(A=projected_height_2, B=-2)
pt_9 = ConstructPoint(XCoordinate=division_13, YCoordinate=division_14, ZCoordinate=0)
pt_10 = ConstructPoint(XCoordinate=division_15, YCoordinate=division_16, ZCoordinate=0)
rec_2pt_3 = Rectangle2Pt(Plane=xy_2, PointA=pt_9, PointB=pt_10, Radius=0)  # -> Rectangle, Length
explode_3 = Explode(Curve=rec_2pt_3.Rectangle, Recursive=True)  # -> Segments, Vertices
ln_3 = Line(StartPoint=projection_origin, EndPoint=explode_3.Vertices)
projection_perimeter = Curve(rec_2pt_3.Rectangle)
projection_rays = Geometry([rec_2pt_3.Rectangle, ln_3])

# ----
# Visualise clash between projector and the Kinect (TODO: acount for armature)
projection_perimeter_2 = Curve(projection_perimeter)
projection_origin_2 = Point(lens_origin)
sensor_model_2 = Brep(sensor_model)
extr = ExtrudePoint(Base=projection_perimeter_2, Point=projection_origin_2)
bbx = BrepBrep(BrepA=extr, BrepB=sensor_model_2)  # -> Curves, Points

# ---- group: Physical Setup Visualisation
projector_model_2 = Geometry(projector_model)
example_of_max_model_height_2 = Geometry(example_of_max_model_height)
example_of_sand_surface = Geometry(sand_surface)
sensor_model_3 = Brep(sensor_model)
table_surface_3 = Geometry(table_surface_2)
table_box = Geometry(table_surface)
preview_5 = CustomPreview(Geometry=example_of_max_model_height_2, Material=ColourSwatch(SwatchColor=RGB(255, 131, 8)))
preview_6 = CustomPreview(Geometry=example_of_sand_surface, Material=ColourSwatch(SwatchColor=RGB(255, 131, 8)))
preview_7 = CustomPreview(Geometry=sensor_model_3, Material=ColourSwatch(SwatchColor=RGB(0, 0, 0)))
preview_8 = CustomPreview(Geometry=projector_model_2, Material=ColourSwatch(SwatchColor=RGB(255, 234, 0)))
preview_9 = CustomPreview(Geometry=table_surface_3, Material=ColourSwatch(SwatchColor=RGB(255, 255, 255)))
preview_10 = CustomPreview(Geometry=table_box, Material=ColourSwatch(SwatchColor=RGB(189, 189, 189)))

# ---- group: Perimeters and Rays
projection_rays_2 = Geometry(projection_rays)
preview_11 = CustomPreview(Geometry=projection_rays_2, Material=ColourSwatch(SwatchColor=RGB(255, 255, 0)))

# ---- group: Label Individual Dimensions and Resolution
color_pixels_x_6 = Number(color_pixels_x_5)
color_pixels_y_5 = Number(color_pixels_y_4)
vertical_depth_range_2 = Number(vertical_depth_range)
horizontal_depth_range_2 = Number(horizontal_depth_range)
horizontal_color_range_2 = Number(horizontal_color_range)
depth_pixels_y_5 = Number(depth_pixels_y_4)
vertical_color_range_2 = Number(vertical_color_range)
text_offset = Slider(36, range=0..100)
depth_pixels_x_4 = Number(depth_pixels_x_3)
division_17 = Division(A=horizontal_depth_range_2, B=2)
division_18 = Division(A=vertical_color_range_2, B="-2")
division_19 = Division(A=horizontal_color_range_2, B=2)
division_20 = Division(A=horizontal_depth_range_2, B=color_pixels_x_6)
division_21 = Division(A=horizontal_depth_range_2, B=color_pixels_y_5)
division_22 = Division(A=vertical_depth_range_2, B=depth_pixels_x_4)
division_23 = Division(A=vertical_depth_range_2, B=depth_pixels_y_5)
addition_6 = Addition(A=division_18, B=text_offset)
addition_7 = Addition(A=division_17)
Y = UnitY(Factor=text_offset)
pt_11 = ConstructPoint(XCoordinate=division_19, YCoordinate=addition_6, ZCoordinate=0)
pt_12 = ConstructPoint(XCoordinate=addition_7, YCoordinate=0, ZCoordinate=0)
move_7 = Move(Geometry=pt_12, Motion=Y)  # -> Geometry, Transform
move_8 = Move(Geometry=move_7.Geometry, Motion=Y)  # -> Geometry, Transform
move_9 = Move(Geometry=pt_11, Motion=Y)  # -> Geometry, Transform
move_10 = Move(Geometry=move_9.Geometry, Motion=Y)  # -> Geometry, Transform

# ----
round = Round(A=division_22)
round_2 = Round(A=division_20)
round_3 = Round(A=division_23)
round_4 = Round(A=division_21)
num = Number(round)
num_2 = Number(round_2)
num_3 = Number(round_3)
num_4 = Number(round_4)

# ---- group: Minimum Dimension Labels
pt_13 = ConstructPoint(XCoordinate=min, YCoordinate=0, ZCoordinate=0)
round_5 = Round(Number=addition_4)  # -> Nearest, Floor, Ceiling
round_6 = Round(Number=addition_5)  # -> Nearest, Floor, Ceiling
move_11 = Move(Geometry=pt_13, Motion=Y)  # -> Geometry, Transform
join = TextJoin(Text=[round_6.Floor, "mm modelling height"])
join_2 = TextJoin(Text=[round_5.Floor, "mm modelling width"])

# ----
round_7 = Round(Number=vertical_depth_range_2)  # -> Nearest, Floor, Ceiling
round_8 = Round(Number=horizontal_depth_range_2)  # -> Nearest, Floor, Ceiling
round_9 = Round(Number=vertical_color_range_2)  # -> Nearest, Floor, Ceiling
round_10 = Round(Number=horizontal_color_range_2)  # -> Nearest, Floor, Ceiling

# ---- group: Label Individual Dimensions and Resolution (continued)
join_3 = TextJoin(Text=[num_3, "mm depth pixel width, ", round_7.Nearest, "mm span"])
join_4 = TextJoin(Text=[num, "mm depth pixel height, ", round_8.Nearest, "mm span"])
join_5 = TextJoin(Text=[num_2, "mm color pixel width, ", round_9.Nearest, "mm span"])
join_6 = TextJoin(Text=[num_4, "mm color pixel height, ", round_10.Nearest, "mm span"])

# ---- group: Dimension Visualisation
pt_14 = Point(pt_2)
num_5 = Number(sensor_height)
round_11 = Round(Number=height_of_projector_above_table)  # -> Nearest, Floor, Ceiling
round_12 = Round(Number=num_5)  # -> Nearest, Floor, Ceiling
text_color_2 = ColourSwatch(SwatchColor=RGB(255, 255, 255))
panel = Panel(join_6)
panel_2 = Panel(join_3)
text_color_3 = ColourSwatch(SwatchColor=RGB(255, 0, 255))
panel_3 = Panel(join_4)
panel_4 = Panel(join_5)
text_color_4 = ColourSwatch(SwatchColor=RGB(0, 255, 255))
join_7 = TextJoin(Text=[" ", round_11.Nearest, "mm projector height"])
join_8 = TextJoin(Text=[" ", round_12.Nearest, "mm sensor height"])
tag = TextTag3D(Location=pt_8, Text=join_7, Size=text_size, Colour=ColourSwatch(SwatchColor=RGB(255, 255, 0)), Justification=7)
tag_2 = TextTag3D(Location=pt_14, Text=join_8, Size=text_size, Colour=ColourSwatch(SwatchColor=RGB(0, 0, 0)), Justification=7)
tag_3 = TextTag3D(Location=pt_13, Text=join, Size=text_size, Colour=text_color_2, Justification=7)
tag_4 = TextTag3D(Location=move_11.Geometry, Text=join_2, Size=text_size, Colour=text_color_2, Justification=7)
tag_5 = TextTag3D(Location=move_7.Geometry, Text=join_3, Size=text_size, Colour=text_color_3, Justification=7)
tag_6 = TextTag3D(Location=move_8.Geometry, Text=join_4, Size=text_size, Colour=text_color_3, Justification=7)
tag_7 = TextTag3D(Location=move_9.Geometry, Text=join_5, Size=text_size, Colour=text_color_4, Justification=7)
tag_8 = TextTag3D(Location=move_10.Geometry, Text=join_6, Size=text_size, Colour=text_color_4, Justification=7)

# ==== cluster Cluster
P = ClusterInput()
D = ClusterInput()
D_2 = ClusterInput()
# Model FoV a pair of isoceles triangles in each axis
pdecon = Deconstruct(Point=P)  # -> XComponent, YComponent, ZComponent
rad = Radians(Degrees=D)
rad_2 = Radians(Degrees=D_2)
expression = Expression(height=pdecon.ZComponent, vertexAngle=rad_2, Expression="2 * height * tan(vertexAngle/2)")
expression_2 = Expression(height=pdecon.ZComponent, vertexAngle=rad, Expression="2 * height * tan(vertexAngle/2)")
R = ClusterOutput(expression)
R_2 = ClusterOutput(expression_2)
division = Division(A=expression_2, B=2)
division_2 = Division(A=expression, B=2)
division_3 = Division(A=expression_2, B=-2)
division_4 = Division(A=expression, B=-2)
pt = ConstructPoint(XCoordinate=division, YCoordinate=division_4, ZCoordinate=0)
pt_2 = ConstructPoint(XCoordinate=division_3, YCoordinate=division_2, ZCoordinate=0)
rec_2pt = Rectangle2Pt(Plane=PlaneXY(0, 0, 0), PointA=pt_2, PointB=pt, Radius=0)  # -> Rectangle, Length
R_3 = ClusterOutput(rec_2pt.Rectangle)

# ==== cluster Round
number_slider = Slider(100, range=0..100)
A = ClusterInput()
multiplication = Multiplication(A=A, B=number_slider)
round = Round(Number=multiplication)  # -> Nearest, Floor, Ceiling
division = Division(A=round.Nearest, B=number_slider)
R = ClusterOutput(division)

# ==== cluster MakeSand
G = ClusterInput()
T = ClusterInput()
A = ClusterInput()
number_slider = Slider(10, range=0..10)
division = Division(A=A, B=Slider(3, range=0..10))
move = Move(Geometry=G, Motion=T)  # -> Geometry, Transform
number_slider_2 = Slider(42, range=0..100)
boundary = BoundarySurfaces(Edges=move.Geometry)
sdivide = DivideSurface(Surface=boundary, UCount=number_slider, VCount=10)  # -> flatten(Points), Normals, Parameters
lng = ListLength(List=sdivide.Points)
addition = Addition(A=number_slider, B=1)
random = Random(Range=division, Number=lng, Seed=2)
Z = UnitZ(Factor=random)
move_2 = Move(Geometry=sdivide.Points, Motion=Z)  # -> Geometry, Transform
srfgrid = SurfaceFromPoints(Points=move_2.Geometry, UCount=addition, Interpolate=True)
S = ClusterOutput(srfgrid)

# ==== cluster Cluster_2
P = ClusterInput()
D = ClusterInput()
pdecon = Deconstruct(Point=P)  # -> XComponent, YComponent, ZComponent
rad = Radians(Degrees=D)
# Model FoV a pair of isoceles triangles in each axis
expression = Expression(height=pdecon.ZComponent, vertexAngle=rad, Expression="2 * height * tan(vertexAngle/2)")
pt = ConstructPoint(XCoordinate=0, YCoordinate=0, ZCoordinate=0)
sqr = Square(Value=expression)
sqr_2 = Square(Value=expression)
division = Division(A=expression, B=-2)
addition = Addition(A=sqr_2, B=sqr)
circle = CircleCNR(Center=pt, Normal=Vector(0, 0, 1), Radius=division)
sqrt = SquareRoot(Value=addition)
division_2 = Division(A=sqrt, B=2)
C = ClusterOutput(circle)
division_3 = Division(A=division_2, B=2)
division_4 = Division(A=division_2, B=2)
multiplication = Multiplication(A=division_4, B=-1)
multiplication_2 = Multiplication(A=division_3, B=-1)
pt_2 = ConstructPoint(XCoordinate=division_4, YCoordinate=division_3, ZCoordinate=0)
R = ClusterOutput(expression)
R_2 = ClusterOutput(division_2)
pt_3 = ConstructPoint(XCoordinate=multiplication, YCoordinate=multiplication_2, ZCoordinate=0)
rec_2pt = Rectangle2Pt(Plane=PlaneXY(0, 0, 0), PointA=pt_2, PointB=pt_3, Radius=0)  # -> Rectangle, Length
R_3 = ClusterOutput(rec_2pt.Rectangle)
